# Grasshopper definition 00-rhinospatial-reference-workflow.gh (Grasshopper 1.0.8)
# plug-ins: RhinoSpatial

# ----
# Shared Spatical Context
# Define the study area once.
# 
# Inputs:
# - optional SRS, e.g. EPSG:25832
# - optional WFS/WMS reference URL
# - optional WFS/WMS reference layer
# - Button to open the map helper
# - optional absolute coordinates toggle
button = Button()
# RhinoSpatial Reference Definition
# Define one Spatial Context, then connect it to each source group.
# All loaded layers use the same selected area and align in the same Rhino / Grasshopper space.
spatial_context = SpatialContext(
    OpenMap=button,
    UseAbsoluteCoordinates=False,
    PersistedSelection_BoundingBox25832="477780.112,5550819.875,477935.647,5550962.058",
    PersistedSelection_BoundingBox25833="48915.170,5569856.964,49081.944,5570011.482",
    PersistedSelection_BoundingBox27700="1163622.465,78173.101,1163797.354,78336.561",
    PersistedSelection_BoundingBox3857="967283.108,6465212.177,967524.337,6465433.143",
    PersistedSelection_BoundingBox4283="8.689252,50.109219,8.691419,50.110492",
    PersistedSelection_BoundingBox4326="8.689252,50.109219,8.691419,50.110492",
    PersistedSelection_BoundingBox7844="8.689252,50.109219,8.691419,50.110492")

# ----
# LoD2 Data
# Load official 3D building and roof geometry
# inside the selected Spatial Context.
# 
# Accepted sources:
# - LoD2 WFS service URL
# - local CityGML / GML / XML file
# - local CityJSON file
# - folder with LoD2 files
# - ZIP archive with LoD2 files
# - optional layer name
panel = Panel("https://www.geoportal.hessen.de/mapbender/php/wfs.php?FEATURETYPE_ID=5589&INSPIRE=1&REQUEST=GetCapabilities&SERVICE=WFS&VERSION=2.0.0")
load_lod2 = LoadLoD2Buildings(LoD2Source=panel, SpatialContext=spatial_context)  # -> Buildings, Status

# ----
# Terrain
# Load terrain or elevation data as an aligned mesh.
# 
# Accepted sources:
# - WCS service URL
# - local GeoTIFF DEM (.tif / .tiff)
# - local Esri ASCII Grid (.asc)
# - local XYZ / CSV terrain grid
# - optional coverage id or EPSG code
# - leave URL empty for small-area global terrain fallback
panel_2 = Panel("https://inspire-hessen.de/raster/dgm1/ows?REQUEST=GetCapabilities&SERVICE=WCS&VERSION=2.1.0")
load_terrain = LoadTerrain(TerrainServiceURL=panel_2, SpatialContext=spatial_context)  # -> Terrain, Status

# ----
# GeoTIFF
# Load a local georeferenced raster image into the same study space.
# 
# Accepted sources:
# - local GeoTIFF file (.tif / .tiff)
# - GeoTIFF should include readable EPSG georeferencing
# Connect local .tif / .tiff path here
# GeoTIFF / Local Raster
# 
# Load GeoTIFF expects a local georeferenced .tif / .tiff file.
# 
# Connect your own local GeoTIFF path here to test raster placement.
path = FilePath("/Users/pascalnun/Downloads/bau_planungsrecht_20260604_101226.tiff")
load_geotiff = LoadGeoTIFF(GeoTIFFFile=path, SpatialContext=spatial_context)  # -> ImageMesh, Material, ImageFile, Status

# ----
# Vector Data / WFS
# Load vector features such as parcels, planning
# data, roads, boundaries, or building footprints.
# 
# Accepted sources:
# - WFS service URL
# - OGC API Features URL
# - local Shapefile (.shp)
# - local GeoJSON (.geojson / .json)
# - one or more layer names
panel_3 = Panel("https://www.geoportal.hessen.de/mapbender/php/wfs.php?FEATURETYPE_ID=5042&INSPIRE=1&REQUEST=GetCapabilities&SERVICE=WFS&VERSION=2.0.0")
wfs_layers = ListWFSLayers(WFSServiceURL=panel_3)
load_wfs = LoadWFS(WFSServiceURL=panel_3, Layer=wfs_layers, MaxFeatures=0, SpatialContext=spatial_context)

# ----
# Google3D Tile Viewer
# View Google Photorealistic 3D Tiles as
# bounded visual reference context.
# 
# Inputs:
# - user-managed Google Maps API key
# - Spatial Context
# - Enable toggle
# API Key
toggle = BooleanToggle(False)
_3d_tiles_view = _3DTilesViewerGoogle(APIKey="your API Key Here", SpatialContext=spatial_context, EnableViewer=toggle)  # -> Status, ViewerActive, Meshes, Materials

# ----
# OSM Context
# Load lightweight OpenStreetMap context for
# quick site studies and black-plan views.
# 
# Available groups:
# - buildings
# - roads
# - water
# - green / open space
# - rail
# 
# Inputs:
# - leave OSM URL empty for the built-in public source
# - optional Overpass API endpoint override
# - toggles for each context group
toggle_2 = BooleanToggle(True)
load_osm = LoadOSM(SpatialContext=spatial_context, Buildings=True, Road=True, Water=toggle_2, Green=toggle_2, Rail=toggle_2)  # -> Buildings, Road, Water, Green, Rail, Status

# ----
# WMS / Map Imagery
# Load orthophotos, maps, or raster overlays as an aligned image mesh.
# 
# Accepted sources:
# - WMS service URL
# - optional WMS layer name
# - optional image format, e.g. image/png
# - leave URL empty for fallback map/imagery context
panel_4 = Panel("https://www.gds-srv.hessen.de/cgi-bin/lika-services/ogc-free-images.ows?language=ger&SERVICE=WMS&VERSION=1.3.0&REQUEST=GetCapabilities")

# ----
# Select Layer
wms_layers = ListWMSLayers(WMSServiceURL=panel_4)
item = ListItem(List=wms_layers, Index=Slider(9, range=0..10), Wrap=True)

load_wms = LoadWMS(WMSServiceURL=panel_4, Layer=item, SpatialContext=spatial_context, Format="image/png")  # -> ImageMesh, Material, ImageFile, GetMapURL
