# Grasshopper definition 01-wfs-wms-basics.gh (Grasshopper 1.0.8)
# plug-ins: RhinoSpatial, Human

# ----
# Spatial Context
button = Button()
spatial_context = SpatialContext(
    OpenMap=button,
    UseAbsoluteCoordinates=False,
    PersistedSelection_BoundingBox25832="477931.204,5551548.489,478428.613,5552018.634",
    PersistedSelection_BoundingBox25833="49124.991,5570545.395,49659.596,5571054.974",
    PersistedSelection_BoundingBox27700="1163617.395,78922.752,1164178.926,79460.950",
    PersistedSelection_BoundingBox3857="967513.629,6466352.836,968285.165,6467083.766",
    PersistedSelection_BoundingBox4283="8.691323,50.115790,8.698254,50.120000",
    PersistedSelection_BoundingBox4326="8.691323,50.115790,8.698254,50.120000",
    PersistedSelection_BoundingBox7844="8.691323,50.115790,8.698254,50.120000")

# ----
# WFS Load
# WFS Layer Selection (All)
panel = Panel("https://www.geoportal.hessen.de/mapbender/php/wfs.php?FEATURETYPE_ID=5042&INSPIRE=1&REQUEST=GetCapabilities&SERVICE=WFS&VERSION=2.0.0")
wfs_layers = ListWFSLayers(WFSServiceURL=panel)
load_wfs = LoadWFS(WFSServiceURL=panel, Layer=wfs_layers, MaxFeatures=0, SpatialContext=spatial_context)

# ----
# WMF Load
# WMF Layer Selection
panel_2 = Panel("https://www.gds-srv.hessen.de/cgi-bin/lika-services/ogc-free-images.ows?language=ger&SERVICE=WMS&VERSION=1.3.0&REQUEST=GetCapabilities")
wms_layers = ListWMSLayers(WMSServiceURL=panel_2)
item = ListItem(List=wms_layers, Index=Slider(5, range=0..10), Wrap=True)
load_wms = LoadWMS(WMSServiceURL=panel_2, Layer=item, SpatialContext=spatial_context, Format="image/png")  # -> ImageMesh, Material, ImageFile, GetMapURL

previewlw = CustomPreviewLineweights(Geometry=load_wfs, Shader=ColourSwatch(SwatchColor=RGB(255, 0, 47)), Absolute=False)
