# Grasshopper definition 01-wms-wfs-basics.gh (Grasshopper 1.0.8)
# plug-ins: RhinoSpatial

# ----
# Shared Spatical Context
# Define the study area once.
# 
# Inputs:
# - optional SRS, e.g. EPSG:25832
# - optional WFS/WMS reference URL
# - optional WFS/WMS reference layer
# - Button to open the map helper
# - optional absolute coordinates toggle
button = Button()
# RhinoSpatial Definition | map plus official vector data
# Define one Spatial Context, then connect it to each source group.
# All loaded layers use the same selected area and align in the same Rhino / Grasshopper space.
spatial_context = SpatialContext(
    OpenMap=button,
    UseAbsoluteCoordinates=False,
    PersistedSelection_BoundingBox25832="477780.112,5550819.875,477935.647,5550962.058",
    PersistedSelection_BoundingBox25833="48915.170,5569856.964,49081.944,5570011.482",
    PersistedSelection_BoundingBox27700="1163622.465,78173.101,1163797.354,78336.561",
    PersistedSelection_BoundingBox3857="967283.108,6465212.177,967524.337,6465433.143",
    PersistedSelection_BoundingBox4283="8.689252,50.109219,8.691419,50.110492",
    PersistedSelection_BoundingBox4326="8.689252,50.109219,8.691419,50.110492",
    PersistedSelection_BoundingBox7844="8.689252,50.109219,8.691419,50.110492")

# ----
# Vector Data / WFS
# Load vector features such as parcels, planning
# data, roads, boundaries, or building footprints.
# 
# Accepted sources:
# - WFS service URL
# - OGC API Features URL
# - local Shapefile (.shp)
# - local GeoJSON (.geojson / .json)
# - one or more layer names
panel = Panel("https://www.geoportal.hessen.de/mapbender/php/wfs.php?FEATURETYPE_ID=5042&INSPIRE=1&REQUEST=GetCapabilities&SERVICE=WFS&VERSION=2.0.0")
wfs_layers = ListWFSLayers(WFSServiceURL=panel)
load_wfs = LoadWFS(WFSServiceURL=panel, Layer=wfs_layers, MaxFeatures=0, SpatialContext=spatial_context)

# ----
# WMS / Map Imagery
# Load orthophotos, maps, or raster overlays as an aligned image mesh.
# 
# Accepted sources:
# - WMS service URL
# - optional WMS layer name
# - optional image format, e.g. image/png
# - leave URL empty for fallback map/imagery context
panel_2 = Panel("https://www.gds-srv.hessen.de/cgi-bin/lika-services/ogc-free-images.ows?language=ger&SERVICE=WMS&VERSION=1.3.0&REQUEST=GetCapabilities")

# ----
# Select Layer
wms_layers = ListWMSLayers(WMSServiceURL=panel_2)
item = ListItem(List=wms_layers, Index=Slider(9, range=0..10), Wrap=True)

load_wms = LoadWMS(WMSServiceURL=panel_2, Layer=item, SpatialContext=spatial_context, Format="image/png")  # -> ImageMesh, Material, ImageFile, GetMapURL
