# Grasshopper definition 02-geotiff-terrain.gh (Grasshopper 1.0.8)
# plug-ins: RhinoSpatial

# ----
# Shared Spatical Context
# Define the study area once.
# 
# Inputs:
# - optional SRS, e.g. EPSG:25832
# - optional WFS/WMS reference URL
# - optional WFS/WMS reference layer
# - Button to open the map helper
# - optional absolute coordinates toggle
button = Button()
# RhinoSpatial Definition | raster/file-based/elevation
# Define one Spatial Context, then connect it to each source group.
# All loaded layers use the same selected area and align in the same Rhino / Grasshopper space.
spatial_context = SpatialContext(
    OpenMap=button,
    UseAbsoluteCoordinates=False,
    PersistedSelection_BoundingBox25832="477780.112,5550819.875,477935.647,5550962.058",
    PersistedSelection_BoundingBox25833="48915.170,5569856.964,49081.944,5570011.482",
    PersistedSelection_BoundingBox27700="1163622.465,78173.101,1163797.354,78336.561",
    PersistedSelection_BoundingBox3857="967283.108,6465212.177,967524.337,6465433.143",
    PersistedSelection_BoundingBox4283="8.689252,50.109219,8.691419,50.110492",
    PersistedSelection_BoundingBox4326="8.689252,50.109219,8.691419,50.110492",
    PersistedSelection_BoundingBox7844="8.689252,50.109219,8.691419,50.110492")

# ----
# Terrain
# Load terrain or elevation data as an aligned mesh.
# 
# Accepted sources:
# - WCS service URL
# - local GeoTIFF DEM (.tif / .tiff)
# - local Esri ASCII Grid (.asc)
# - local XYZ / CSV terrain grid
# - optional coverage id or EPSG code
# - leave URL empty for small-area global terrain fallback
panel = Panel("https://inspire-hessen.de/raster/dgm1/ows?REQUEST=GetCapabilities&SERVICE=WCS&VERSION=2.1.0")
load_terrain = LoadTerrain(TerrainServiceURL=panel, SpatialContext=spatial_context)  # -> Terrain, Status

# ----
# GeoTIFF
# Load a local georeferenced raster image into the same study space.
# 
# Accepted sources:
# - local GeoTIFF file (.tif / .tiff)
# - GeoTIFF should include readable EPSG georeferencing
# Connect local .tif / .tiff path here
# GeoTIFF / Local Raster
# 
# Load GeoTIFF expects a local georeferenced .tif / .tiff file.
# 
# Connect your own local GeoTIFF path here to test raster placement.
path = FilePath("/Users/pascalnun/Downloads/bau_planungsrecht_20260604_101226.tiff")
load_geotiff = LoadGeoTIFF(GeoTIFFFile=path, SpatialContext=spatial_context)  # -> ImageMesh, Material, ImageFile, Status
