# Grasshopper definition 02-lod2-terrain-context.gh (Grasshopper 1.0.8)
# plug-ins: RhinoSpatial, Human

# ----
# Spatial Context
button = Button()
spatial_context = SpatialContext(
    OpenMap=button,
    UseAbsoluteCoordinates=False,
    PersistedSelection_BoundingBox25832="477908.959,5552291.078,478082.452,5552518.174",
    PersistedSelection_BoundingBox25833="49162.520,5571315.250,49354.076,5571556.010",
    PersistedSelection_BoundingBox27700="1163520.039,79657.892,1163724.743,79908.474",
    PersistedSelection_BoundingBox3857="967474.216,6467510.141,967742.940,6467863.662",
    PersistedSelection_BoundingBox4283="8.690969,50.122456,8.693383,50.124492",
    PersistedSelection_BoundingBox4326="8.690969,50.122456,8.693383,50.124492",
    PersistedSelection_BoundingBox7844="8.690969,50.122456,8.693383,50.124492")

# ----
# WFS Load
# WFS Layer Selection (All)
panel = Panel("https://www.geoportal.hessen.de/mapbender/php/wfs.php?FEATURETYPE_ID=5042&INSPIRE=1&REQUEST=GetCapabilities&SERVICE=WFS&VERSION=2.0.0")
wfs_layers = ListWFSLayers(WFSServiceURL=panel)
load_wfs = LoadWFS(WFSServiceURL=panel, Layer=wfs_layers, MaxFeatures=0, SpatialContext=spatial_context)

# ----
# WMF Load
# WMF Layer Selection
panel_2 = Panel("https://www.gds-srv.hessen.de/cgi-bin/lika-services/ogc-free-images.ows?language=ger&SERVICE=WMS&VERSION=1.3.0&REQUEST=GetCapabilities")
wms_layers = ListWMSLayers(WMSServiceURL=panel_2)
item = ListItem(List=wms_layers, Index=Slider(5, range=0..10), Wrap=True)
load_wms = LoadWMS(WMSServiceURL=panel_2, Layer=item, SpatialContext=spatial_context, Format="image/png")  # -> ImageMesh, Material, ImageFile, GetMapURL

# ----
# LoD2 Load
panel_3 = Panel("https://www.geoportal.hessen.de/mapbender/php/wfs.php?FEATURETYPE_ID=5589&INSPIRE=1&REQUEST=GetCapabilities&SERVICE=WFS&VERSION=2.0.0")
load_lod2 = LoadLoD2Buildings(LoD2ServiceURL=panel_3, SpatialContext=spatial_context)

# ----
# Terrain Load
panel_4 = Panel("https://inspire-hessen.de/raster/dgm1/ows?REQUEST=GetCapabilities&SERVICE=WCS&VERSION=2.1.0")
load_terrain = LoadTerrain(TerrainServiceURL=panel_4, SpatialContext=spatial_context)  # -> Terrain, Status

debrep = DeconstructBrep(Brep=load_lod2)  # -> Faces, Edges, Vertices
preview = CustomPreview(Geometry=load_terrain.Terrain, Material=ColourSwatch(SwatchColor=RGBA(237, 237, 237, 251)))
previewlw = CustomPreviewLineweights(Geometry=load_wfs, Shader=ColourSwatch(SwatchColor=RGB(255, 0, 47)), Absolute=False)
preview_2 = CustomPreview(Geometry=debrep.Faces, Material=ColourSwatch(SwatchColor=RGB(255, 255, 255)))
previewlw_2 = CustomPreviewLineweights(Geometry=debrep.Edges, Shader=ColourSwatch(SwatchColor=RGB(0, 0, 0)), Absolute=False)
