# Grasshopper definition 03-lod2-buildings.gh (Grasshopper 1.0.8)
# plug-ins: RhinoSpatial

# ----
# Shared Spatical Context
# Define the study area once.
# 
# Inputs:
# - optional SRS, e.g. EPSG:25832
# - optional WFS/WMS reference URL
# - optional WFS/WMS reference layer
# - Button to open the map helper
# - optional absolute coordinates toggle
button = Button()
# RhinoSpatial Definition | official 3D building context
# Define one Spatial Context, then connect it to each source group.
# All loaded layers use the same selected area and align in the same Rhino / Grasshopper space.
spatial_context = SpatialContext(
    OpenMap=button,
    UseAbsoluteCoordinates=False,
    PersistedSelection_BoundingBox25832="477780.112,5550819.875,477935.647,5550962.058",
    PersistedSelection_BoundingBox25833="48915.170,5569856.964,49081.944,5570011.482",
    PersistedSelection_BoundingBox27700="1163622.465,78173.101,1163797.354,78336.561",
    PersistedSelection_BoundingBox3857="967283.108,6465212.177,967524.337,6465433.143",
    PersistedSelection_BoundingBox4283="8.689252,50.109219,8.691419,50.110492",
    PersistedSelection_BoundingBox4326="8.689252,50.109219,8.691419,50.110492",
    PersistedSelection_BoundingBox7844="8.689252,50.109219,8.691419,50.110492")

# ----
# Terrain
# Load terrain or elevation data as an aligned mesh.
# 
# Accepted sources:
# - WCS service URL
# - local GeoTIFF DEM (.tif / .tiff)
# - local Esri ASCII Grid (.asc)
# - local XYZ / CSV terrain grid
# - optional coverage id or EPSG code
# - leave URL empty for small-area global terrain fallback
panel = Panel("https://inspire-hessen.de/raster/dgm1/ows?REQUEST=GetCapabilities&SERVICE=WCS&VERSION=2.1.0")
load_terrain = LoadTerrain(TerrainServiceURL=panel, SpatialContext=spatial_context)  # -> Terrain, Status

# ----
# LoD2 Data
# Load official 3D building and roof geometry
# inside the selected Spatial Context.
# 
# Accepted sources:
# - LoD2 WFS service URL
# - local CityGML / GML / XML file
# - local CityJSON file
# - folder with LoD2 files
# - ZIP archive with LoD2 files
# - optional layer name
panel_2 = Panel("https://www.geoportal.hessen.de/mapbender/php/wfs.php?FEATURETYPE_ID=5589&INSPIRE=1&REQUEST=GetCapabilities&SERVICE=WFS&VERSION=2.0.0")
load_lod2 = LoadLoD2Buildings(LoD2Source=panel_2, SpatialContext=spatial_context)  # -> Buildings, Status
