# Grasshopper definition 03-osm-blackplan.gh (Grasshopper 1.0.8)
# plug-ins: RhinoSpatial, Human

# ----
# Spatial Context
button = Button()
spatial_context = SpatialContext(
    OpenMap=button,
    UseAbsoluteCoordinates=False,
    PersistedSelection_BoundingBox25832="477711.465,5550728.564,478013.828,5551126.093",
    PersistedSelection_BoundingBox25833="48839.263,5569759.504,49173.240,5570180.840",
    PersistedSelection_BoundingBox27700="1163530.780,78072.545,1163887.755,78510.979",
    PersistedSelection_BoundingBox3857="967176.828,6465070.128,967645.005,6465688.790",
    PersistedSelection_BoundingBox4283="8.688297,50.108401,8.692503,50.111965",
    PersistedSelection_BoundingBox4326="8.688297,50.108401,8.692503,50.111965",
    PersistedSelection_BoundingBox7844="8.688297,50.108401,8.692503,50.111965")

# ----
# WFS Load
# WFS Layer Selection (All)
panel = Panel("https://www.geoportal.hessen.de/mapbender/php/wfs.php?FEATURETYPE_ID=5042&INSPIRE=1&REQUEST=GetCapabilities&SERVICE=WFS&VERSION=2.0.0")
wfs_layers = ListWFSLayers(WFSServiceURL=panel)
load_wfs = LoadWFS(WFSServiceURL=panel, Layer=wfs_layers, MaxFeatures=0, SpatialContext=spatial_context)

# ----
# WMF Load
# WMF Layer Selection
panel_2 = Panel("https://www.gds-srv.hessen.de/cgi-bin/lika-services/ogc-free-images.ows?language=ger&SERVICE=WMS&VERSION=1.3.0&REQUEST=GetCapabilities")
wms_layers = ListWMSLayers(WMSServiceURL=panel_2)
item = ListItem(List=wms_layers, Index=Slider(5, range=0..10), Wrap=True)
load_wms = LoadWMS(WMSServiceURL=panel_2, Layer=item, SpatialContext=spatial_context, Format="image/png")  # -> ImageMesh, Material, ImageFile, GetMapURL

# ----
# LoD2 Load
panel_3 = Panel("https://www.geoportal.hessen.de/mapbender/php/wfs.php?FEATURETYPE_ID=5589&INSPIRE=1&REQUEST=GetCapabilities&SERVICE=WFS&VERSION=2.0.0")
load_lod2 = LoadLoD2Buildings(LoD2ServiceURL=panel_3, SpatialContext=spatial_context)

# ----
# Terrain Load
panel_4 = Panel("https://inspire-hessen.de/raster/dgm1/ows?REQUEST=GetCapabilities&SERVICE=WCS&VERSION=2.1.0")
load_terrain = LoadTerrain(TerrainServiceURL=panel_4, SpatialContext=spatial_context)  # -> Terrain, Status

toggle = BooleanToggle(True)
load_osm = LoadOSM(SpatialContext=spatial_context, Buildings=True, Road=toggle, Water=toggle, Green=toggle, Rail=False)  # -> Buildings, Road, Water, Green, Rail, Status

preview = CustomPreview(Geometry=load_osm.Green, Material=ColourSwatch(SwatchColor=RGB(116, 156, 90)))
preview_2 = CustomPreview(Geometry=load_osm.Water, Material=ColourSwatch(SwatchColor=RGB(90, 133, 156)))
preview_3 = CustomPreview(Geometry=load_osm.Road, Material=ColourSwatch(SwatchColor=RGB(199, 199, 199)))
preview_4 = CustomPreview(Geometry=load_osm.Buildings, Material=ColourSwatch(SwatchColor=RGB(0, 0, 0)))
debrep = DeconstructBrep(Brep=load_lod2)  # -> Faces, Edges, Vertices
preview_5 = CustomPreview(Geometry=load_terrain.Terrain, Material=ColourSwatch(SwatchColor=RGBA(237, 237, 237, 251)))
previewlw = CustomPreviewLineweights(Geometry=load_wfs, Shader=ColourSwatch(SwatchColor=RGB(255, 0, 47)), Absolute=False)
preview_6 = CustomPreview(Geometry=debrep.Faces, Material=ColourSwatch(SwatchColor=RGB(255, 255, 255)))
previewlw_2 = CustomPreviewLineweights(Geometry=debrep.Edges, Shader=ColourSwatch(SwatchColor=RGB(0, 0, 0)), Absolute=False)
