# Grasshopper definition 04-osm-context.gh (Grasshopper 1.0.8)
# plug-ins: RhinoSpatial, Human

# ----
# Shared Spatical Context
# Define the study area once.
# 
# Inputs:
# - optional SRS, e.g. EPSG:25832
# - optional WFS/WMS reference URL
# - optional WFS/WMS reference layer
# - Button to open the map helper
# - optional absolute coordinates toggle
button = Button()
# RhinoSpatial Definition | lightweight fallback / black-plan workflow
# Define one Spatial Context, then connect it to each source group.
# All loaded layers use the same selected area and align in the same Rhino / Grasshopper space.
spatial_context = SpatialContext(
    OpenMap=button,
    UseAbsoluteCoordinates=False,
    PersistedSelection_BoundingBox25832="477780.112,5550819.875,477935.647,5550962.058",
    PersistedSelection_BoundingBox25833="48915.170,5569856.964,49081.944,5570011.482",
    PersistedSelection_BoundingBox27700="1163622.465,78173.101,1163797.354,78336.561",
    PersistedSelection_BoundingBox3857="967283.108,6465212.177,967524.337,6465433.143",
    PersistedSelection_BoundingBox4283="8.689252,50.109219,8.691419,50.110492",
    PersistedSelection_BoundingBox4326="8.689252,50.109219,8.691419,50.110492",
    PersistedSelection_BoundingBox7844="8.689252,50.109219,8.691419,50.110492")

# ----
# Terrain
# Load terrain or elevation data as an aligned mesh.
# 
# Accepted sources:
# - WCS service URL
# - local GeoTIFF DEM (.tif / .tiff)
# - local Esri ASCII Grid (.asc)
# - local XYZ / CSV terrain grid
# - optional coverage id or EPSG code
# - leave URL empty for small-area global terrain fallback
panel = Panel("https://inspire-hessen.de/raster/dgm1/ows?REQUEST=GetCapabilities&SERVICE=WCS&VERSION=2.1.0")
load_terrain = LoadTerrain(TerrainServiceURL=panel, SpatialContext=spatial_context)  # -> Terrain, Status

# ----
# OSM Context
# Load lightweight OpenStreetMap context for
# quick site studies and black-plan views.
# 
# Available groups:
# - buildings
# - roads
# - water
# - green / open space
# - rail
# 
# Inputs:
# - leave OSM URL empty for the built-in public source
# - optional Overpass API endpoint override
# - toggles for each context group
toggle = BooleanToggle(True)
load_osm = LoadOSM(SpatialContext=spatial_context, Buildings=True, Road=True, Water=toggle, Green=toggle, Rail=toggle)  # -> Buildings, Road, Water, Green, Rail, Status

debrep = DeconstructBrep(Brep=load_osm.Buildings)  # -> Faces, Edges, Vertices
previewlw = CustomPreviewLineweights(Geometry=debrep.Edges, Shader=ColourSwatch(SwatchColor=RGB(0, 0, 0)), Absolute=False)
preview = CustomPreview(Geometry=load_osm.Water, Material=ColourSwatch(SwatchColor=RGB(79, 177, 219)))
preview_2 = CustomPreview(Geometry=debrep.Faces, Material=ColourSwatch(SwatchColor=RGB(255, 255, 255)))
preview_3 = CustomPreview(Geometry=load_osm.Road, Material=ColourSwatch(SwatchColor=RGB(128, 128, 128)))
preview_4 = CustomPreview(Geometry=load_osm.Green, Material=ColourSwatch(SwatchColor=RGB(136, 178, 112)))
