# Grasshopper definition 05-google-3d-tiles-reference.gh (Grasshopper 1.0.8)
# plug-ins: RhinoSpatial

# ----
# Shared Spatical Context
# Define the study area once.
# 
# Inputs:
# - optional SRS, e.g. EPSG:25832
# - optional WFS/WMS reference URL
# - optional WFS/WMS reference layer
# - Button to open the map helper
# - optional absolute coordinates toggle
button = Button()
# RhinoSpatial Definition | Google 3D Tiles Reference
# View Google Photorealistic 3D Tiles as visual reference context
# for the selected Spatial Context.
# 
# Requires:
# - your own Google Maps Platform API key
# - Map Tiles API enabled
# - billing set up in Google Cloud
# - Enable toggle set to True
# 
# Do not commit or share your API key.
# This is a visual reference viewer, not editable project data.
spatial_context = SpatialContext(
    OpenMap=button,
    UseAbsoluteCoordinates=False,
    PersistedSelection_BoundingBox25832="477141.820,5550815.622,477500.451,5551086.427",
    PersistedSelection_BoundingBox25833="48277.082,5569887.836,48657.029,5570187.163",
    PersistedSelection_BoundingBox27700="1162968.704,78074.944,1163363.902,78394.950",
    PersistedSelection_BoundingBox3857="966289.442,6465202.698,966845.999,6465623.102",
    PersistedSelection_BoundingBox4283="8.680326,50.109164,8.685325,50.111586",
    PersistedSelection_BoundingBox4326="8.680326,50.109164,8.685325,50.111586",
    PersistedSelection_BoundingBox7844="8.680326,50.109164,8.685325,50.111586")

# ----
# Google3D Tile Viewer
# View Google Photorealistic 3D Tiles as
# bounded visual reference context.
# 
# Inputs:
# - user-managed Google Maps API key
# - Spatial Context
# - Enable toggle
# API Key
toggle = BooleanToggle(False)
_3d_tiles_view = _3DTilesViewerGoogle(APIKey="your API Key Here", SpatialContext=spatial_context, EnableViewer=toggle)  # -> Status, ViewerActive, Meshes, Materials
